# Grasshopper definition Clamp_gen_0.01.gh (Grasshopper 1.0.8)
# plug-ins: CORE.Toolbox.Grasshopper, Python, Human UI, GhPython Script

# ----
# Lenght at max bend
panel = Panel("Foam Lenght")
L = Slider(143, range=120..160)
panel_2 = Panel("FoamRadius")
panel_3 = Panel("FoamHeight")
R = Slider(2.5, range=0.5..2.7)
H = Slider(21, range=6..30)
lmax = Slider(156, range=120..170)
bendmax = Slider(43.5, range=10..200)
panel_4 = Panel("Rad_max_bend")

panel_5 = Panel("Clasp Lenght")
panel_6 = Panel("Arc A")
panel_7 = Panel("Arc C")
panel_8 = Panel("Arc B")
panel_9 = Panel("Width")
panel_10 = Panel("T1")
panel_11 = Panel("T3")
panel_12 = Panel("T2")
width = Slider(25, range=10..40)
at = Slider(3.5, range=1..4.5)
aa = Slider(0.5, range=0.1..2)
clasp_lenght = Slider(5.5, range=4..12)
ba = Slider(0.5, range=0.1..2)
bt = Slider(3, range=1.75..4)
ct = Slider(3, range=1..5)
ca = Slider(0.3, range=0.1..2)

colour_picker = ColourPicker(PickedColour=RGB(207, 207, 207))
panel_13 = Panel("C:\Users\ruben\OneDrive - UGent\Medtech_bridge\04_Project_files\01_Larynx_clamp\Parametric\MaterialProperties.png")
create_slider = CreateSlider(Slider=R, ShowBounds=False, ShowTicks=False, ShowTooltip=False, ShowValLabel=True, showLabel=True)
create_slider_2 = CreateSlider(Slider=L, ShowBounds=False, ShowTicks=False, ShowTooltip=False, ShowValLabel=True, showLabel=True)
create_slider_3 = CreateSlider(Slider=lmax, ShowBounds=False, ShowTicks=False, ShowTooltip=False, ShowValLabel=True, showLabel=True)
create_slider_4 = CreateSlider(Slider=H, ShowBounds=False, ShowTicks=False, ShowTooltip=False, ShowValLabel=True, showLabel=True)
create_slider_5 = CreateSlider(Slider=bendmax, ShowBounds=False, ShowTicks=False, ShowTooltip=False, ShowValLabel=True, showLabel=True)
value_listener = ValueListener(Elements=create_slider_4, SomeProperty=True)  # -> Values, Indices
value_listener_2 = ValueListener(Elements=create_slider, SomeProperty=True)  # -> Values, Indices
floating_pt_slider = Slider(0.5, range=0..1)
floating_pt_slider_2 = Slider(0.5, range=0..1)
value_listener_3 = ValueListener(Elements=create_slider_2, SomeProperty=True)  # -> Values, Indices
value_listener_4 = ValueListener(Elements=create_slider_3, SomeProperty=True)  # -> Values, Indices
value_listener_5 = ValueListener(Elements=create_slider_5, SomeProperty=True)  # -> Values, Indices

neck_circumference = Slider(352, range=250..400)
neck_h_w_ratio = Slider(0.95, range=0.75..2)
panel_14 = Panel("NeckCircumference")
panel_15 = Panel("NeckRatio")

subtraction = Subtraction(A=value_listener.Values, B=Slider(1.5, range=0..10))
finished = BooleanToggle(False)
panel_16 = Panel("finished")
create_text_block = CreateTextBlock(TextSize=12, Justification=0)
create_slider_6 = CreateSlider(Slider=neck_circumference, ShowBounds=False, ShowTicks=False, ShowTooltip=False, ShowValLabel=True, showLabel=True)
create_slider_7 = CreateSlider(Slider=neck_h_w_ratio, ShowBounds=False, ShowTicks=False, ShowTooltip=False, ShowValLabel=True, showLabel=True)
create_label = CreateLabel(LabelText="Patient measurements", LabelSize=12, Justification=0)
panel_17 = Panel("RatioConstant")
create_slider_8 = CreateSlider(Slider=ba, ShowBounds=False, ShowTicks=False, ShowTooltip=False, ShowValLabel=True, showLabel=True)
create_slider_9 = CreateSlider(Slider=at, ShowBounds=False, ShowTicks=False, ShowTooltip=False, ShowValLabel=True, showLabel=True)
create_slider_10 = CreateSlider(Slider=bt, ShowBounds=False, ShowTicks=False, ShowTooltip=False, ShowValLabel=True, showLabel=True)

create_slider_11 = CreateSlider(Slider=width, ShowBounds=False, ShowTicks=False, ShowTooltip=False, ShowValLabel=True, showLabel=True)
create_image = CreateImage(ImageSource=panel_13, ImageWidth=Slider(354, range=0..1000))
value_listener_6 = ValueListener(Elements=create_slider_11, SomeProperty=True)  # -> Values, Indices

create_slider_12 = CreateSlider(Slider=aa, ShowBounds=False, ShowTicks=False, ShowTooltip=False, ShowValLabel=True, showLabel=True)
create_slider_13 = CreateSlider(Slider=ca, ShowBounds=False, ShowTicks=False, ShowTooltip=False, ShowValLabel=True, showLabel=True)
value_listener_7 = ValueListener(Elements=create_slider_6, SomeProperty=True)  # -> Values, Indices
value_listener_8 = ValueListener(Elements=create_slider_7, SomeProperty=True)  # -> Values, Indices

panel_18 = Panel("C:\Users\ruben\OneDrive - UGent\Medtech_bridge\04_Project_files\01_Larynx_clamp\Parametric\Exports")
create_text_box = CreateTextBox(Label="FileDirectory", DefaultText=panel_18, UpdateButton=True, showLabel=True)
create_checkbox = CreateCheckbox(Label="Print Circumference", StartingValue=True)
create_checkbox_2 = CreateCheckbox(Label="Print ratio", StartingValue=True)
value_listener_9 = ValueListener(Elements=create_text_box, SomeProperty=True)  # -> Values, Indices
value_listener_10 = ValueListener(Elements=create_checkbox, SomeProperty=True)  # -> Values, Indices
value_listener_11 = ValueListener(Elements=create_checkbox_2, SomeProperty=True)  # -> Values, Indices
concatenate = Concatenate(
    Fragment_A=simplify(flatten("Ratio")),
    Fragment_B=simplify(flatten(value_listener_8.Values)),
    A=simplify(flatten("Width")),
    B=simplify(flatten(value_listener_6.Values)),
    C=simplify(flatten("Circ")),
    D=simplify(flatten(value_listener_7.Values)))  # -> simplify(flatten(Result))
merge = Merge(Data1=flatten(create_text_box), Data2=flatten(create_checkbox_2), Data3=flatten(create_checkbox))

text = Text(value_listener_8.Values)
expression = Expression(x=value_listener_8.Values, Expression="(3*(1+x))-sqrt(((3+x)*(1+(3*x))))")
create_slider_14 = CreateSlider(Slider=ct, ShowBounds=False, ShowTicks=False, ShowTooltip=False, ShowValLabel=True, showLabel=True)
create_slider_15 = CreateSlider(Slider=clasp_lenght, ShowBounds=False, ShowTicks=False, ShowTooltip=False, ShowValLabel=True, showLabel=True)
merge_2 = Merge(
    Data2=flatten(create_slider_11),
    Data3=flatten(create_slider_12),
    Data4=flatten(create_slider_9),
    Data5=flatten(create_slider_8),
    Data6=flatten(create_slider_10),
    Data7=flatten(create_slider_13),
    Data8=flatten(create_slider_14),
    Data9=flatten(create_slider_15))  # -> flatten(Result)
adjust_element_positioning = AdjustElementPositioning(
    ElementsToAdjust=merge_2,
    Margin=flatten("0.5,0.5,0.5,0.5"),
    AbsolutePositioning=False,
    Width=Slider(361.2, range=0.1..900))
expression_2 = Expression(x=value_listener_4.Values, y=value_listener_3.Values, z=value_listener_5.Values, Expression="((x/y)-1)*(z)")
panel_19 = Panel(concatenate)
panel_20 = Panel("BendingConstant")
expression_3 = Expression(x=value_listener_7.Values, y=expression, Expression="x/(y*π)")
adjust_element_appearance = AdjustElementAppearance(ElementsToAdjust=create_text_block, Background=colour_picker, FontSize=Slider(0.428, range=0.001..2))
value_listener_12 = ValueListener(Elements=create_slider_8, SomeProperty=True)  # -> Values, Indices
value_listener_13 = ValueListener(Elements=create_slider_9, SomeProperty=True)  # -> Values, Indices
value_listener_14 = ValueListener(Elements=create_slider_10, SomeProperty=True)  # -> Values, Indices
value_listener_15 = ValueListener(Elements=create_slider_12, SomeProperty=True)  # -> Values, Indices
value_listener_16 = ValueListener(Elements=create_slider_13, SomeProperty=True)  # -> Values, Indices
value_listener_17 = ValueListener(Elements=create_slider_14, SomeProperty=True)  # -> Values, Indices
value_listener_18 = ValueListener(Elements=create_slider_15, SomeProperty=True)  # -> Values, Indices
panel_21 = Panel("RadNeck")
merge_3 = Merge(
    Data1=create_image,
    Data2=flatten(create_slider_4),
    Data3=flatten(create_slider),
    Data4=flatten(create_slider_2),
    Data5=flatten(create_slider_3),
    Data6=flatten(create_slider_5))  # -> flatten(Result)
expression_4 = Expression(x=value_listener_3.Values, y=expression_2, z=expression_3, Expression="x*(1+(y/z))")
panel_22 = Panel("FoamLenBent")
addition = Addition(A=expression_3, B=subtraction)
multiplication = Multiplication(A=expression_3, B=value_listener_8.Values)
expression_5 = Expression(x=expression_4, y=value_listener_12.Values, z=value_listener_14.Values, Expression="x+(2*(y+z))")
addition_2 = Addition(A=multiplication, B=subtraction)
panel_23 = Panel("ArcLeng")
ellipse = Ellipse(Plane=PlaneXY(0, 0, 0), Radius1=addition_2, Radius2=addition)  # -> reparameterize(Ellipse), Focus1, Focus2
adjust_element_positioning_2 = AdjustElementPositioning(ElementsToAdjust=merge_3, Margin=Slider(0.01, range=0..0.01), AbsolutePositioning=False, Width=Slider(414, range=1..950))
construct_point = ConstructPoint(XCoordinate=0, YCoordinate=addition, ZCoordinate=0)
adjust_element_appearance_2 = AdjustElementAppearance(ElementsToAdjust=merge_3, FontSize=Slider(12.2, range=0.1..60))
curve_closest_point = CurveClosestPoint(Point=construct_point, Curve=ellipse.Ellipse)  # -> Point, Parameter, Distance
seam = Seam(Curve=ellipse.Ellipse, Seam=curve_closest_point.Parameter)
construct_domain = ConstructDomain(DomainStart=expr("-x/2", value_listener_6.Values), DomainEnd=expr("x/2", value_listener_6.Values))
panel_24 = Panel("C:\Users\ruben\OneDrive - UGent\Medtech_bridge\04_Project_files\01_Larynx_clamp\Parametric\Clamp.png")
yz_plane = YZPlane(Origin=construct_point)
division = Division(A=expression_5, B=2)
number_slider = Slider(90, range=0..180)
evaluate_length = EvaluateLength(Curve=seam, Length=division, Normalized=False)  # -> Point, Tangent, Parameter
rectangle = Rectangle(Plane=yz_plane, XSize=value_listener_13.Values, YSize=construct_domain, Radius=0)  # -> Rectangle, Length
unit_z = UnitZ(Factor=1)
negative = Negative(Value=value_listener_15.Values)
addition_3 = Addition(A=value_listener_13.Values, B=value_listener_15.Values)
sine = Sine(Value=degrees(number_slider))
division_2 = Division(A=value_listener_17.Values, B=2)
deconstruct_brep = DeconstructBrep(Brep=rectangle.Rectangle)  # -> Faces, Edges, Vertices
unit_y = UnitY(Factor=negative)
rotate = Rotate(Vector=evaluate_length.Tangent, Axis=unit_z, Angle=degrees(number_slider))
shatter = Shatter(Curve=seam, Parameters=flatten([evaluate_length.Parameter, Slider(0, range=0..1)]))
unit_y_2 = UnitY(Factor=addition_3)
multiplication_2 = Multiplication(A=sine, B=subtraction)
addition_4 = Addition(A=value_listener_16.Values, B=division_2)
move = Move(Geometry=construct_point, Motion=unit_y_2)  # -> Geometry, Transform
move_2 = Move(Geometry=construct_point, Motion=unit_y)  # -> Geometry, Transform
list_item = ListItem(List=shatter, Index=0, Wrap=True)
explode_tree = ExplodeTree(Data=simplify(graft(deconstruct_brep.Edges)))  # -> Branch0, Branch1, Branch2, Branch3
explode_tree_2 = ExplodeTree(Data=simplify(graft(deconstruct_brep.Vertices)))  # -> Branch0, Branch1, Branch2, Branch3
addition_5 = Addition(A=multiplication_2, B=addition_4)
create_image_2 = CreateImage(ImageSource=panel_24, ImageWidth=Slider(340, range=0..1000))
arc_3pt = Arc3Pt(PointA=explode_tree_2.Branch0, PointB=move_2.Geometry, PointC=explode_tree_2.Branch3)  # -> Arc, Plane, Radius
arc_3pt_2 = Arc3Pt(PointA=explode_tree_2.Branch1, PointB=move.Geometry, PointC=explode_tree_2.Branch2)  # -> Arc, Plane, Radius
create_button = CreateButton(ButtonName="Finished?", ButtonStyle=0)
create_button_2 = CreateButton(ButtonName="Export", ButtonStyle=0)
join_curves = JoinCurves(Curves=flatten([explode_tree.Branch2, explode_tree.Branch0, arc_3pt.Arc, arc_3pt_2.Arc]), Preserve=False)
value_listener_19 = ValueListener(Elements=create_button_2, SomeProperty=True)  # -> Values, Indices
value_listener_20 = ValueListener(Elements=create_button, SomeProperty=True)  # -> Values, Indices
offset_curve = OffsetCurve(Curve=seam, Distance=expr("-x", addition_5), Corners=1)
create_expander = CreateExpander(UIElements=flatten(create_image_2), Header="Legenda", Open=True)
project_point = ProjectPoint(Point=evaluate_length.Point, Direction=rotate, Geometry=offset_curve)  # -> Point, Index
toggle = Toggle(port=value_listener_20.Values)
unit_z_2 = UnitZ(Factor=1)
vector_2pt = Vector2Pt(PointA=evaluate_length.Point, PointB=project_point.Point, Unitize=True)  # -> Vector, Length
merge_4 = Merge(Data1=flatten(merge_2), Data2=flatten(create_expander))
hide_show_element = HideShowElement(ElementToHideShow=create_button_2, Show=toggle, Collapse=True, Disable=False)
rotate_2 = Rotate(Vector=vector_2pt.Vector, Axis=expr("-x", unit_z_2), Angle=degrees(Slider(90, range=0..100)))
hide_show_element_2 = HideShowElement(ElementToHideShow=[create_slider_6, merge_4, create_slider_7], Show=True, Collapse=True, Disable=toggle)
create_expander_2 = CreateExpander(UIElements=flatten(merge_4), Header="Clip parameters", Open=True)
construct_plane = ConstructPlane(Origin=project_point.Point, XAxis=vector_2pt.Vector, YAxis=unit_z_2)
construct_plane_2 = ConstructPlane(Origin=project_point.Point, XAxis=rotate_2, YAxis=unit_z_2)
division_3 = Division(A=value_listener_13.Values, B=2)
addition_6 = Addition(A=division_3, B=addition_5)
construct_domain_2 = ConstructDomain(DomainStart=expr("-x/2", value_listener_17.Values), DomainEnd=expr("x/2", value_listener_17.Values))
construct_domain_3 = ConstructDomain(DomainStart=expr("-x/2", value_listener_6.Values), DomainEnd=expr("x/2", value_listener_6.Values))
amplitude = Amplitude(Vector=unitize(rotate), Amplitude=addition_6)
division_4 = Division(A=value_listener_17.Values, B=2)
rectangle_2 = Rectangle(Plane=construct_plane, XSize=construct_domain_2, YSize=construct_domain_3, Radius=0)  # -> Rectangle, Length
reverse = Reverse(Vector=amplitude)
addition_7 = Addition(A=value_listener_16.Values, B=division_4)
construct_domain_4 = ConstructDomain(DomainStart=expr("-x/2", value_listener_6.Values), DomainEnd=expr("x/2", value_listener_6.Values))
negative_2 = Negative(Value=value_listener_14.Values)
negative_3 = Negative(Value=addition_7)
move_3 = Move(Geometry=project_point.Point, Motion=reverse)  # -> Geometry, Transform
deconstruct_brep_2 = DeconstructBrep(Brep=rectangle_2.Rectangle)  # -> Faces, Edges, Vertices
amplitude_2 = Amplitude(Vector=vector_2pt.Vector, Amplitude=addition_7)
amplitude_3 = Amplitude(Vector=vector_2pt.Vector, Amplitude=negative_3)
rectangle_3 = Rectangle(Plane=construct_plane_2, XSize=negative_2, YSize=construct_domain_4, Radius=0)  # -> Rectangle, Length
addition_8 = Addition(A=ca, B=value_listener_14.Values)
line = Line(StartPoint=project_point.Point, EndPoint=move_3.Geometry)
move_4 = Move(Geometry=project_point.Point, Motion=amplitude_2)  # -> Geometry, Transform
explode_tree_3 = ExplodeTree(Data=simplify(graft(deconstruct_brep_2.Edges)))  # -> Branch0, Branch1, Branch2, Branch3
explode_tree_4 = ExplodeTree(Data=simplify(graft(deconstruct_brep_2.Vertices)))  # -> Branch0, Branch1, Branch2, Branch3
move_5 = Move(Geometry=project_point.Point, Motion=amplitude_3)  # -> Geometry, Transform
amplitude_4 = Amplitude(Vector=unitize(rotate_2), Amplitude=addition_8)
deconstruct_brep_3 = DeconstructBrep(Brep=rectangle_3.Rectangle)  # -> Faces, Edges, Vertices
reverse_2 = Reverse(Vector=amplitude_4)
arc_3pt_3 = Arc3Pt(PointA=explode_tree_4.Branch0, PointB=move_5.Geometry, PointC=explode_tree_4.Branch3)  # -> Arc, Plane, Radius
arc_3pt_4 = Arc3Pt(PointA=explode_tree_4.Branch1, PointB=move_4.Geometry, PointC=explode_tree_4.Branch2)  # -> Arc, Plane, Radius
explode_tree_5 = ExplodeTree(Data=simplify(graft(deconstruct_brep_3.Edges)))  # -> Branch0, Branch1, Branch2, Branch3
explode_tree_6 = ExplodeTree(Data=simplify(graft(deconstruct_brep_3.Vertices)))  # -> Branch0, Branch1, Branch2, Branch3
move_6 = Move(Geometry=project_point.Point, Motion=reverse_2)  # -> Geometry, Transform
join_curves_2 = JoinCurves(Curves=flatten([explode_tree_3.Branch2, explode_tree_3.Branch0, arc_3pt_3.Arc, arc_3pt_4.Arc]), Preserve=False)
arc_3pt_5 = Arc3Pt(PointA=explode_tree_6.Branch0, PointB=move_6.Geometry, PointC=explode_tree_6.Branch3)  # -> Arc, Plane, Radius
curve_closest_point_2 = CurveClosestPoint(Point=project_point.Point, Curve=offset_curve)  # -> Point, Parameter, Distance
join_curves_3 = JoinCurves(Curves=flatten([explode_tree_5.Branch2, explode_tree_5.Branch0, arc_3pt_5.Arc, explode_tree_5.Branch1]), Preserve=False)
sweep1 = Sweep1(Rail=line, Sections=join_curves_3, Miter=1)
seam_2 = Seam(Curve=offset_curve, Seam=curve_closest_point_2.Parameter)
addition_9 = Addition(A=value_listener_18.Values, B=addition_8)
flip_curve = FlipCurve(Curve=seam_2)  # -> Curve, Flag
cap_holes = CapHoles(Brep=sweep1)
division_5 = Division(A=value_listener_6.Values, B=2)
evaluate_length_2 = EvaluateLength(Curve=flip_curve.Curve, Length=addition_9, Normalized=False)  # -> Point, Tangent, Parameter
unit_z_3 = UnitZ(Factor=division_5)
reverse_3 = Reverse(Vector=unit_z_3)
shatter_2 = Shatter(Curve=flip_curve.Curve, Parameters=flatten([evaluate_length_2.Parameter, Slider(0, range=0..1)]))
move_7 = Move(Geometry=evaluate_length_2.Point, Motion=[reverse_3, unit_z_3])  # -> Geometry, Transform
list_item_2 = ListItem(List=shatter_2, Index=0, Wrap=True)
sweep1_2 = Sweep1(Rail=list_item, Sections=join_curves, Miter=1)
sweep1_3 = Sweep1(Rail=list_item_2, Sections=join_curves_2, Miter=1)
cap_holes_2 = CapHoles(Brep=sweep1_2)
cap_holes_3 = CapHoles(Brep=sweep1_3)
solid_union = SolidUnion(Breps=flatten([cap_holes_3, cap_holes_2, cap_holes]))
merge_faces = MergeFaces(Brep=solid_union)  # -> Breps, Before, After
brep_plane = BrepPlane(Brep=merge_faces.Breps, Plane=PlaneXY(0, 0, 0))  # -> Curves, Points
discontinuity = Discontinuity(Curve=brep_plane.Curves, Level=1)  # -> Points, Parameters
merge_5 = Merge(Data1=Slider(3, range=0..10), Data2=Slider(4, range=0..10))
merge_6 = Merge(Data1=Slider(0, range=0..100), Data2=Slider(7, range=0..11))
deconstruct_brep_4 = DeconstructBrep(Brep=merge_faces.Breps)  # -> Faces, Edges, Vertices
list_item_3 = ListItem(List=flatten(discontinuity.Points), Index=graft(merge_5), Wrap=True)  # -> simplify(Item)
list_item_4 = ListItem(List=flatten(discontinuity.Points), Index=graft(merge_6), Wrap=True)  # -> simplify(Item)
addition_10 = Addition(A=value_listener_2.Values, B=value_listener_13.Values)
curve_closest_point_3 = CurveClosestPoint(Point=list_item_4, Curve=flatten(deconstruct_brep_4.Edges))  # -> Point, Parameter, Distance
curve_closest_point_4 = CurveClosestPoint(Point=list_item_3, Curve=flatten(deconstruct_brep_4.Edges))  # -> Point, Parameter, Distance
smaller_than = SmallerThan(FirstNumber=curve_closest_point_3.Distance, SecondNumber=0.01)  # -> SmallerThan, OrEqualTo
smaller_than_2 = SmallerThan(FirstNumber=curve_closest_point_4.Distance, SecondNumber=0.01)  # -> SmallerThan, OrEqualTo
merge_7 = Merge(Data1=graft(value_listener_2.Values), Data2=graft(addition_10))  # -> simplify(graft(Result))
list_index = ListIndex(List=deconstruct_brep_4.Edges)
list_index_2 = ListIndex(List=deconstruct_brep_4.Edges)
cull_pattern = CullPattern(List=flatten(list_index), CullPattern=smaller_than.SmallerThan)
cull_pattern_2 = CullPattern(List=flatten(list_index_2), CullPattern=smaller_than_2.SmallerThan)
merge_8 = Merge(Data1=cull_pattern_2, Data2=cull_pattern)
flip_matrix = FlipMatrix(Data=merge_8)
longest_list = LongestList(ListListA=flip_matrix, ListListB=merge_7, PaddingMode=2)  # -> ListListA, ListListB
fillet_edge = FilletEdge(Shape=merge_faces.Breps, Blend=2, Metric=0, Edges=flatten(flip_matrix), Radii=flatten(longest_list.ListListB))
deconstruct_brep_5 = DeconstructBrep(Brep=fillet_edge)  # -> Faces, Edges, Vertices
curve_closest_point_5 = CurveClosestPoint(Point=graft(move_7.Geometry), Curve=flatten(deconstruct_brep_5.Edges))  # -> Point, Parameter, Distance
smaller_than_3 = SmallerThan(FirstNumber=curve_closest_point_5.Distance, SecondNumber=0.01)  # -> SmallerThan, OrEqualTo
list_index_3 = ListIndex(List=deconstruct_brep_5.Edges)
addition_11 = Addition(A=value_listener_2.Values, B=Slider(1.25, range=0.01..5))
cull_pattern_3 = CullPattern(List=list_index_3, CullPattern=smaller_than_3.SmallerThan)
subtraction_2 = Subtraction(A=value_listener_18.Values, B=addition_11)
fillet_edges = FilletEdges(
    Brep=fillet_edge,
    Indices=flatten(cull_pattern_3),
    RadiiA=subtraction_2,
    RadiiB=subtraction_2,
    Blend=1,
    Rail=Slider(2, range=0..2),
    Edges=1)
brep_plane_2 = BrepPlane(Brep=fillet_edges, Plane=PlaneXY(0, 0, 0))  # -> Curves, Points
discontinuity_2 = Discontinuity(Curve=brep_plane_2.Curves, Level=1)  # -> Points, Parameters
deconstruct_brep_6 = DeconstructBrep(Brep=fillet_edges)  # -> Faces, Edges, Vertices
deconstruct = Deconstruct(Point=discontinuity_2.Points)  # -> XComponent, YComponent, ZComponent
round = Round(Number=deconstruct.XComponent)  # -> Nearest, Floor, Ceiling
equality = Equality(FirstNumber=round.Nearest, SecondNumber=0)  # -> Equality, Inequality
construct_domain_5 = ConstructDomain(DomainStart=0, DomainEnd=value_listener_17.Values)
cull_pattern_4 = CullPattern(List=discontinuity_2.Points, CullPattern=equality.Inequality)  # -> graft(List)
explode_tree_7 = ExplodeTree(Data=simplify(cull_pattern_4))  # -> Branch0, Branch1
curve_closest_point_6 = CurveClosestPoint(Point=explode_tree_7.Branch1, Curve=flatten(deconstruct_brep_6.Edges))  # -> Point, Parameter, Distance
curve_closest_point_7 = CurveClosestPoint(Point=explode_tree_7.Branch0, Curve=flatten(deconstruct_brep_6.Edges))  # -> Point, Parameter, Distance
remap_numbers = RemapNumbers(Value=Slider(0.208, range=0..1), Source=Domain(0, 1), Target=construct_domain_5)  # -> Mapped, Clipped
construct_domain_6 = ConstructDomain(DomainStart=0, DomainEnd=subtraction_2)
smaller_than_4 = SmallerThan(FirstNumber=curve_closest_point_6.Distance, SecondNumber=0.01)  # -> SmallerThan, OrEqualTo
smaller_than_5 = SmallerThan(FirstNumber=curve_closest_point_7.Distance, SecondNumber=0.01)  # -> SmallerThan, OrEqualTo
addition_12 = Addition(A=remap_numbers.Mapped, B=Slider(0.001, range=0.001..2))
remap_numbers_2 = RemapNumbers(Value=Slider(0.208, range=0..1), Source=Domain(0, 1), Target=construct_domain_6)  # -> Mapped, Clipped
list_index_4 = ListIndex(List=deconstruct_brep_6.Edges)
list_index_5 = ListIndex(List=deconstruct_brep_6.Edges)
subtraction_3 = Subtraction(A=value_listener_17.Values, B=addition_12)
merge_9 = Merge(Data1=graft(subtraction_3), Data2=graft(remap_numbers.Mapped))  # -> simplify(graft(Result))
cull_pattern_5 = CullPattern(List=flatten(list_index_4), CullPattern=smaller_than_4.SmallerThan)
cull_pattern_6 = CullPattern(List=flatten(list_index_5), CullPattern=smaller_than_5.SmallerThan)
addition_13 = Addition(A=remap_numbers_2.Mapped, B=Slider(0.001, range=0.001..2))
subtraction_4 = Subtraction(A=subtraction_2, B=addition_13)
addition_14 = Addition(A=subtraction_3, B=Slider(0.35, range=0..1))
merge_10 = Merge(Data1=cull_pattern_6, Data2=cull_pattern_5)
smaller_than_6 = SmallerThan(FirstNumber=subtraction_2, SecondNumber=addition_14)  # -> SmallerThan, OrEqualTo
merge_11 = Merge(Data1=graft(subtraction_4), Data2=graft(remap_numbers_2.Mapped))  # -> simplify(graft(Result))
stream_filter = StreamFilter(Gate=smaller_than_6.SmallerThan, Stream0=merge_9, Stream1=merge_11)
fillet_edge_2 = FilletEdge(Shape=fillet_edges, Blend=2, Metric=0, Edges=flatten(merge_10), Radii=flatten(stream_filter))
mirror = Mirror(Geometry=fillet_edge_2, Plane=PlaneYZ(0, 0, 0))  # -> Geometry, Transform
solid_union_2 = SolidUnion(Breps=flatten([fillet_edge_2, mirror.Geometry]))
panel_25 = Panel("TextSize")
deconstruct_brep_7 = DeconstructBrep(Brep=solid_union_2)  # -> Faces, Edges, Vertices
list_item_5 = ListItem(List=deconstruct_brep_7.Faces, Index=Slider(1, range=0..35), Wrap=True)
list_item_6 = ListItem(List=deconstruct_brep_7.Faces, Index=Slider(18, range=0..35), Wrap=True)
brep_plane_3 = BrepPlane(Brep=list_item_5, Plane=PlaneXY(0, 0, 0))  # -> Curves, Points
brep_plane_4 = BrepPlane(Brep=list_item_6, Plane=PlaneXY(0, 0, 0))  # -> Curves, Points
multiplication_3 = Multiplication(A=value_listener_6.Values, B=Slider(0.33, range=0..1))
larger_than = LargerThan(FirstNumber=value_listener_6.Values, SecondNumber="8")  # -> LargerThan, OrEqualTo
construct_domain_7 = ConstructDomain(DomainStart="8", DomainEnd=multiplication_3)
remap_numbers_3 = RemapNumbers(Value=Slider(0.337, range=0.001..1), Source=Domain(0, 1), Target=construct_domain_7)  # -> Mapped, Clipped
concatenate_2 = Concatenate(FragmentA=value_listener_7.Values, FragmentB="mm")
stream_filter_2 = StreamFilter(Gate=larger_than.OrEqualTo, Stream0="8", Stream1=remap_numbers_3.Mapped)
concatenate_3 = Concatenate(FragmentA="Ratio", FragmentB=value_listener_8.Values, JoinSeparator=" - ")
concatenate_4 = Concatenate(Fragment_A="⌀", Fragment_B=concatenate_2, JoinSeparator=" - ")
negative_4 = Negative(Value=Slider(0.5, range=0..1))
negative_5 = Negative(Value=Slider(0.5, range=0..1))
flip_curve_2 = FlipCurve(Curve=brep_plane_3.Curves)  # -> Curve, Flag
text_on_surface = TextOnSurface(
    Text=concatenate_4,
    Font="Sans Bold:no Italic:no",
    Height=stream_filter_2,
    Depth=flatten(negative_5),
    BaseLine=brep_plane_4.Curves,
    BaseSurface=list_item_6)
text_on_surface_2 = TextOnSurface(
    Text=concatenate_3,
    Font="Sans Bold:no Italic:no",
    Height=stream_filter_2,
    Depth=negative_4,
    BaseLine=flip_curve_2.Curve,
    BaseSurface=list_item_5)
stream_filter_3 = StreamFilter(Gate=value_listener_10.Values, Stream1=text_on_surface)
stream_filter_4 = StreamFilter(Gate=value_listener_11.Values, Stream1=text_on_surface_2)
stream_filter_5 = StreamFilter(Gate=toggle, Stream1=stream_filter_3)
stream_filter_6 = StreamFilter(Gate=toggle, Stream1=stream_filter_4)
area = Area(Geometry=stream_filter_6)  # -> Area, Centroid
area_2 = Area(Geometry=stream_filter_5)  # -> Area, Centroid
xy_plane = XYPlane(Origin=Point(0, 0, 0))
solid_union_3 = SolidUnion(Breps=flatten(stream_filter_5))
cap_holes_ex = CapHolesEx(Brep=solid_union_3)  # -> Brep, Caps, Solid
mirror_2 = Mirror(Geometry=cap_holes_ex.Brep, Plane=xy_plane)  # -> Geometry, Transform
surface_closest_point = SurfaceClosestPoint(Point=area.Centroid, Surface=list_item_5)  # -> Point, UVPoint, Distance
surface_closest_point_2 = SurfaceClosestPoint(Point=area_2.Centroid, Surface=list_item_6)  # -> Point, UVPoint, Distance
mesh_box = MeshBox(
    Base={Plane=PlaneXY(0, 0, 0), X=Domain(-10, 10), Y=Domain(-10, 10), Z=Domain(-10, 10)},
    XCount=subtraction,
    YCount=subtraction,
    ZCount=subtraction)
mesh_brep = MeshBrep(
    Brep=mirror_2.Geometry,
    Settings={GridMaxCount=0, GridMinCount=16, JaggedSeams=False, MaxEdgeLength=0, MinEdgeLength=0.0001, MinTolerance=0, Refine=True, RefineAngle=0, RelativeTolerance=0.65, SimplePlanes=True, Tolerance=0})
evaluate_surface = EvaluateSurface(Surface=flatten(list_item_5), Point=surface_closest_point.UVPoint)  # -> Point, Normal, UDirection, VDirection, Frame
evaluate_surface_2 = EvaluateSurface(Surface=flatten(list_item_6), Point=surface_closest_point_2.UVPoint)  # -> Point, Normal, UDirection, VDirection, Frame
mesh_brep_2 = MeshBrep(
    Brep=solid_union_2,
    Settings={GridMaxCount=0, GridMinCount=16, JaggedSeams=False, MaxEdgeLength=0, MinEdgeLength=0.0001, MinTolerance=0, Refine=True, RefineAngle=0, RelativeTolerance=0.65, SimplePlanes=True, Tolerance=0})
negative_6 = Negative(Value=Slider(1, range=0.05..2))
amplitude_5 = Amplitude(Vector=unitize(evaluate_surface_2.Normal), Amplitude=Slider(1, range=0.05..2))
_3dview = Create3DView(MeshToDisplay=mesh_box, MeshColors=RGB(255, 0, 0), ViewWidth=300, ViewHeight=300)
edgesoftening = EdgeSoftening(Mesh=mesh_brep_2, Radius=Slider(0.257, range=0..0.4))
amplitude_6 = Amplitude(Vector=unitize(evaluate_surface.Normal), Amplitude=negative_6)
reverse_4 = Reverse(Vector=amplitude_5)
extrude = Extrude(Base=stream_filter_6, Direction=amplitude_6)
extrude_2 = Extrude(Base=stream_filter_5, Direction=reverse_4)
merge_12 = Merge(
    Data1=flatten(_3dview),
    Data2=flatten(create_label),
    Data3=flatten(create_text_block),
    Data4=flatten(create_slider_6),
    Data5=flatten(create_slider_7),
    Data6=flatten(create_button),
    Data7=flatten(create_button_2))
cap_holes_ex_2 = CapHolesEx(Brep=extrude)  # -> Brep, Caps, Solid
set_3d_view_properties = Set3DViewProperties(_3DView=_3dview, ShowViewCube=Toggle(False))
cap_holes_ex_3 = CapHolesEx(Brep=extrude_2)  # -> Brep, Caps, Solid
mesh_brep_3 = MeshBrep(
    Brep=cap_holes_ex_2.Brep,
    Settings={GridMaxCount=0, GridMinCount=16, JaggedSeams=False, MaxEdgeLength=0, MinEdgeLength=0.0001, MinTolerance=0, Refine=True, RefineAngle=0, RelativeTolerance=0.65, SimplePlanes=True, Tolerance=0})
mesh_brep_4 = MeshBrep(
    Brep=cap_holes_ex_3.Brep,
    Settings={GridMaxCount=0, GridMinCount=16, JaggedSeams=False, MaxEdgeLength=0, MinEdgeLength=0.0001, MinTolerance=0, Refine=True, RefineAngle=0, RelativeTolerance=0.65, SimplePlanes=True, Tolerance=0})
create_stack = CreateStack(UIElements=flatten(merge_12), Horizontal=False)
pan = Panel("""Model editor
Material properties
Export settings""")
merge_13 = Merge(Data1=flatten(create_stack), Data2=flatten(create_expander_2))
launchwin = LaunchWindow(
    Show=Toggle(True),
    Name="MRI Clasp Generator",
    Width=Slider(415, range=0..1000),
    Height=Slider(570, range=0..1000),
    FontFamily="Open Sans",
    ChildStatus=0,
    EnableHorizScroll=False)
tabs = TabbedView(TabNames=pan, TabTextSize=Slider(14, range=0..100), Tab0=flatten(merge_13), Tab1=flatten(merge_3), Tab2=flatten(merge))
mesh_difference = MeshDifference(MeshesA=edgesoftening, MeshesB=flatten([mesh_brep_3, mesh_brep_4]))
addelems = AddElements(Window=launchwin, Elements=flatten(tabs), DoVLChecking=True)  # -> AddedElements, ElementNames
settings_custom = SettingsCustom(
    StitchSeams=True,
    SimplePlanes=True,
    Refine=True,
    MinCount=16,
    MaxCount=Slider(43, range=10..400),
    AspectRatio=20,
    MaxDistance=0,
    MaxAngle=20,
    MinEdge=0,
    MaxEdge=0)
mesh_brep_5 = MeshBrep(Brep=solid_union_2, Settings=settings_custom)
stream_filter_7 = StreamFilter(Gate=toggle, Stream0=mesh_brep_5, Stream1=mesh_difference)  # -> flatten(Stream)
set_3d_view = Set3DView(_3DView=_3dview, MeshToDisplay=stream_filter_7, MeshColors=ColourSwatch(SwatchColor=RGB(43, 150, 217)))
mesh = Mesh(stream_filter_7)
export_stl = ExportSTL(Meshes=mesh, DirectoryPath=value_listener_9.Values, FileName=concatenate, Save=value_listener_19.Values)
